vi "Function.gvi"   [LabVIEW NXG 2.0.0]
panel controls:
  "stop": bool
  "double": f64 = 5
panel indicators:
  "error out": error
  "error out_2": error
  "tag references": "niTag"[]
  "error out_3": error
  "size(s)": i32
uses:
  NI::TagLibrary::Open Tag.gvi
  NI::TagLibrary::Create Tag (Double).gvi
  NI::TagLibrary::Write (Double).gvi
  NI::TagLibrary::Delete Tag (Single).gvi
  NI::TagLibrary::Query Tags.gvi
diagram:
  disable {
    frame Enabled { }
    frame Disabled {
      call "Open Tag.gvi"(tag path="modulation") -> (tag reference out=w1, error out=w2)
      call "Create Tag (Double).gvi"(tag reference in=w1, error in=w2) -> (tag reference out=w3, error out=w4)
      s1 = w4  # shift register
      while {
        call "Write (Double).gvi"(tag reference in=w3, error in=s1, double=$double) -> (tag reference out=w5, error out=w6)
        $"error out" <- w6
        next s1 = w6
        stop if $stop
      }
      call "Delete Tag (Single).gvi"(tag reference in=w5, error in=s1) -> (error out=w7)
      $"error out_2" <- w7
    }
  }
  call "Query Tags.gvi"(search paths=["foo*"]) -> (tag references=w8, error out=w9)
  $"tag references" <- w8
  $"error out_3" <- w9
  Array Size(array=w8) -> (size(s)=w10)
  $"size(s)" <- w10
