vi "Comms.gviweb"   [LabVIEW NXG 2.0.0]
panel controls:
  "url": string = "http://54.82.138.142/nitag/v1/tags/foostr/values/current"
  "stop": bool
  "milliseconds to wait": u32 = 1000
panel indicators:
  "error out": error
  "value": f64[]
  "Chart": f64[]
  "Graph": f64[][]
uses:
  NI::HTTP::Open HTTP Handle.gvi
  NI::HTTP::GET.gvi
  NI::HTTP::Close HTTP Handle.gvi
diagram:
  call "Open HTTP Handle.gvi"(username="admin", password="labview===") -> (client handle out=w1, error out=w2)
  Format Into String(formatString="http://%s/nitag/v1/tags/%s/values/current", "54.82.138.142", "foostr") -> w3
  Initialize Array(element=0, size=3, size=10) -> w4
  s1 = w4  # shift register
  s2 = 0  # shift register
  while {
    Wait(time to wait=$"milliseconds to wait")
    call "GET.gvi"(client handle=w1, url=w3, error in=w2) -> (client handle out=w5, body=w6, error out=w7)
    Match Pattern(regular expression="\\[.*\\]", string=w6) -> (match substring=w8)
    Unflatten From JSON(JSON string=w8, type and defaults=f64[] []) -> (value=w9)
    $Chart <- w9
    $value <- w9
    Increment(x=s2) -> w10
    Is Equal(x=10, y=w10) -> w11
    Select(s=w11, t=0, f=w10) -> w12
    Replace Array Subset(inArray=s1, index=_, index=w12, new=w9) -> w13
    $Graph <- w13
    next s1 = w13
    next s2 = w12
    stop if $stop
  }
  call "Close HTTP Handle.gvi"(client handle=w5, error in=w7) -> (error out=w14)
  $"error out" <- w14
