vi "Get_Tags.gviweb"   [LabVIEW NXG 2.0.0]
panel controls:
  "url": string = "http://54.82.138.142/nitag/v1/tags/foostr/values/current"
panel indicators:
  "value": f64[]
  "Chart": f64[]
  "Graph": f64[][]
  "error out": error
uses:
  NI::HTTP::Open HTTP Handle.gvi
  NI::HTTP::Close HTTP Handle.gvi
diagram:
  call "Open HTTP Handle.gvi"(username="admin", password="labview===") -> (client handle out=w1, error out=w2)
  Format Into String(formatString="http://%s/nitag/v1/tags/%s/values/current", "54.82.138.142", "foostr") -> w3
  Initialize Array(element=0, size=3, size=10) -> w4
  Increment(x=0) -> w5
  Is Equal(x=10, y=w5) -> w6
  Select(s=w6, t=0, f=w5) -> w7
  call "get-tags.gviweb"(client handle out=w1, error out_2=w2, resulting string=w3, initialized array=w4, value_2=w7) -> (client handle=w8, error in=w9, Chart=w10, value=w11, Graph=w12)
  call "Close HTTP Handle.gvi"(client handle=w8, error in=w9) -> (error out=w13)
  $"error out" <- w13
  $Chart <- w10
  $value <- w11
  $Graph <- w12
