vi "Main.gviweb"   [LabVIEW NXG 2.0.0]
panel controls:
  "LED_3": bool = TRUE
  "LED_4": bool = TRUE
  "LED_5": bool = TRUE
panel indicators:
  "URL Image": string
  "STN 1 progress": f64
  "STN 2 progress": f64
  "STN 1=3 progress": f64
  "aggregates": T1[]
  "vibe-data": f64[][]
  "error out": error
types:
  T1 = cluster{"Tester": string, "DUTs Pass": f64, "Drive State": bool}
uses:
  NI::HTTP::Open HTTP Handle.gvi
  NI::HTTP::Close HTTP Handle.gvi
diagram:
  s1 = 0  # shift register
  s2 = 73  # shift register
  s3 = 33  # shift register
  while {
    Wait(time to wait=250)
    call "get-aggregates.gviweb"() -> (Data Grid=w1)
    $aggregates <- w1
    call "progress-update.gviweb"(Numeric=s1) -> (Radial Progress Bar=w2)
    $"STN 1 progress" <- w2
    call "progress-update.gviweb"(Numeric=s2) -> (Radial Progress Bar=w3)
    $"STN 2 progress" <- w3
    call "progress-update.gviweb"(Numeric=s3) -> (Radial Progress Bar=w4)
    $"STN 1=3 progress" <- w4
    next s1 = w2
    next s2 = w3
    next s3 = w4
    stop if FALSE
  }
  call "Open HTTP Handle.gvi"(username="admin", password="labview===") -> (client handle out=w5, error out=w6)
  Format Into String(formatString="http://%s/nitag/v1/tags/%s/values/current", "54.82.138.142", "foostr") -> w7
  Initialize Array(element=0, size=3, size=10) -> w8
  s4 = 0  # shift register
  s5 = w8  # shift register
  while {
    Wait(time to wait=2000)
    Increment(x=s4) -> w9
    Is Equal(x=10, y=w9) -> w10
    Select(s=w10, t=0, f=w9) -> w11
    call "get-tags.gviweb"(client handle out=w5, error out_2=w6, resulting string=w7, initialized array=s5, value_2=w11) -> (client handle=w12, error in=w13, Graph=w14)
    $"vibe-data" <- w14
    next s4 = w11
    next s5 = w14
    stop if FALSE
  }
  call "Close HTTP Handle.gvi"(client handle=w12, error in=w13) -> (error out=w15)
  $"error out" <- w15
  disable {
    frame Enabled { }
    frame Disabled {
      call "get-vibe-data.gviweb"()
    }
  }
